% Simulink data dictionary data_params.sldd

Sig = Simulink.Signal()
p = struct(temp_load_shedding_on=328)
Constant = struct(sigma=5.67e-8)
Area = struct(front=0.08, back=0.08, top=0.1, bottom=0.2, left=0.1, right=0.1, rad=0.1, solar_panel=0.1)
aligned_illum = [0.361032; 0.362125; 0.363222; 0.36434; 0.36544; 0.366543; 0.36766; 0.36876; 0.36986; 0.37097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 0.36711]
aligned_temp = [243.631947; 243.664395; 243.696795; 243.72897; 243.761204; 243.793475; 243.825759; 243.858093; 243.89036; 243.92268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 243.809048]
illum_dist_m = [0; 1; 2; 3; 4; 5; 6; 7; 8; 9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 683.996]
raw_illum = [0.361032; 0.362125; 0.363222; 0.36434; 0.36544; 0.366543; 0.36766; 0.36876; 0.36986; 0.37097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 0.36711]
raw_temp = [243.631947; 243.664395; 243.696795; 243.72897; 243.761204; 243.793475; 243.825759; 243.858093; 243.89036; 243.92268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 243.809048]
route_slope = [0.2156991; 0.2136228; 0.2127705; 0.2108081; 0.206767; 0.2076726; 0.2106082; 0.2115263; 0.2132293; 0.2158135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 0.2076518]
slope_degrees = [12.358649; 12.239684; 12.190849; 12.078417; 11.846879; 11.898765; 12.066959; 12.119566; 12.217138; 12.365205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 11.897574]
slope_radians = [0.2156991; 0.2136228; 0.2127705; 0.2108081; 0.206767; 0.2076726; 0.2106082; 0.2115263; 0.2132293; 0.2158135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 0.2076518]
temp_dist_m = [0; 1; 2; 3; 4; 5; 6; 7; 8; 9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 683.996]
u = [1.75 1.735628 1.721335 1.70712 1.692984 1.678926 1.664947 1.651046 1.637224 1.623481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 2.25]
x = [-2 -1.987469 -1.974937 -1.962406 -1.949875 -1.937343 -1.924812 -1.912281 -1.899749 -1.887218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 3]
xp = [-1 1 0 2]
yp = [1 1 0 1]

Cond = struct(
  area_core_chassis=0.0312,
  thick_core_chassis=0.0254,
  k_core_chassis=1.38,
  area_core_PCM=0.1656,
  thick_core_PCM=0.02,
  k_core_PCM=15,
  area_PCM_rad=0.1656,
  thick_PCM_rad=0.02,
  k_PCM_rad=15,
  area_chassis_PCM=0.00892,
  thick_chassis_PCM=0.02,
  k_chassis_PCM=1.38)

Spec = struct(
  alpha_rad=0.09,
  epsilon_rad=0.91,
  mass_rad_kg=1.8,
  cp_rad_J_kgK=896,
  mass_chassis_kg=11.3,
  cp_chassis_J_kgK=896,
  mass_electronics_kg=5.07,
  cp_electronics_J_kgK=830,
  alpha_mli=0.35,
  epsilon_mli=0.85,
  epsilon_eff_leak_mli=0.03,
  cp_mli_J_kgK=1170,
  mass_PCM=0.7,
  cp_PCM_J_kgK=1908,
  mass_cover=0.91,
  cp_cover=896,
  epsilon_back_cover=0.03,
  epsilon_front_cover=0.85,
  alpha_front_cover=0.91,
  solar_eff=0.3)

IC = struct(
  temp_core=301,
  temp_chassis=299,
  temp_rad=300,
  temp_PCM=300,
  power_motor=0.5,
  temp_MLI_front=242,
  temp_MLI_back=265,
  temp_MLI_top=220,
  temp_MLI_bottom=230,
  temp_MLI_right=272,
  temp_MLI_left=248)

test_bat_AH = 43
test_pcm_mass = 0.7
delta_lat = [8.7e-05; 8.7e-05; 8.7e-05; 8.8e-05; 8.7e-05; 8.7e-05; 8.7e-05; 8.7e-05; 8.8e-05; 8.7e-05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 -8.6e-05]
delta_lon = [0.021917; 0.021876; 0.021837; 0.021797; 0.021757; 0.021718; 0.021678; 0.021639; 0.021599; 0.02156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 -0.021637]
delta_x_meters = [1.104721; 1.103661; 1.102699; 1.101683; 1.100674; 1.099701; 1.098674; 1.097693; 1.096658; 1.095682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 -1.091615]
delta_y_meters = [2.63784; 2.63784; 2.63784; 2.66816; 2.63784; 2.63784; 2.63784; 2.63784; 2.66816; 2.63784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 -2.60752]
distance_km = [0; 0.002864; 0.005728; 0.008593; 0.011457; 0.014321; 0.017185; 0.020049; 0.022913; 0.025778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 2.004927]
distance_m = [0; 2.864; 5.728; 8.593; 11.457; 14.321; 17.185; 20.049; 22.913; 25.778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 2004.927]
elevation_m = [1285.87; 1285.820957; 1285.800692; 1285.780601; 1285.780699; 1285.79; 1285.81; 1285.840768; 1285.87; 1285.921303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 1285.779239]
heading_rad = [0.3966053; 0.3962636; 0.3959531; 0.3915771; 0.3952995; 0.3949852; 0.3946534; 0.3943366; 0.3899674; 0.3936866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 -2.74512]
lat = [-89.90475; -89.904663; -89.904576; -89.904489; -89.904401; -89.904314; -89.904227; -89.90414; -89.904053; -89.903965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 -89.904748]
lon = [42.894973; 42.91689; 42.938766; 42.960603; 42.9824; 43.004157; 43.025875; 43.047553; 43.069192; 43.090791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 42.895825]
route_distance = [0; 2.864; 5.728; 8.593; 11.457; 14.321; 17.185; 20.049; 22.913; 25.778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 2004.927]
route_elevation = [1285.87; 1285.820957; 1285.800692; 1285.780601; 1285.780699; 1285.79; 1285.81; 1285.840768; 1285.87; 1285.921303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 1285.779239]
route_heading = [0.3966053; 0.3962636; 0.3959531; 0.3915771; 0.3952995; 0.3949852; 0.3946534; 0.3943366; 0.3899674; 0.3936866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 -2.74512]
route_illum = [0.3886; 0.3886; 0.3886; 0.3886; 0.3886; 0.37492; 0.37492; 0.37492; 0.37492; 0.37492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 0.3886]
route_max_dist = 2004.927
route_temp = [57.266827; 57.266827; 57.266827; 57.266827; 57.266827; 57.266827; 57.266827; 57.266827; 57.266827; 57.266827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 57.266827]

P = struct(
  driving_speed=0.75,
  mass_rover=15.4,
  temp_load_shedding_off=300,
  temp_load_shedding_on=302,
  power_avionics=22.95,
  gamma_start_sun=45,
  z_start_sun=89.5,
  power_digging=125.2,
  time_digging=30,
  power_load=6.98,
  power_unload=4.9,
  mass_PCM=0.7,
  bat_AH=43)